# Grasshopper definition kangaroo first try.gh (Grasshopper 1.0.7)
# plug-ins: Kangaroo2 Components

number_slider = Slider(37, range=0..100)
pt = ConstructPoint(XCoordinate=0, YCoordinate=0, ZCoordinate=0)
pt_2 = ConstructPoint(XCoordinate=Slider(48, range=0..100), YCoordinate=Slider(50, range=0..100), ZCoordinate=0)
pt_3 = ConstructPoint(XCoordinate=number_slider, YCoordinate=number_slider, ZCoordinate=0)
anchor = Anchor(Point=pt, Strength=10000)
pt_4 = ConstructPoint(XCoordinate=Slider(16, range=0..100), YCoordinate=Slider(42, range=0..100), ZCoordinate=0)
ln = Line(StartPoint=pt_2, EndPoint=pt_4)
anchor_2 = Anchor(Point=pt_3, Strength=10000)
pi = Pi(Factor=Slider(0.6, range=0..1))
ln_2 = Line(StartPoint=pt, EndPoint=pt_3)
length_line = LengthLine(Line=ln_2, Strength=10)
length_line_2 = LengthLine(Line=ln, Strength=10)
angle = Angle(LineA=ln_2, LineB=ln, RestAngle=pi, Strength=1)
merge = Merge(Data1=length_line, Data2=angle, Data3=length_line_2, Data4=anchor, Data5=anchor_2)
solver = Solver(GoalObjects=merge, Reset=Toggle(False), Threshold=1e-15, Tolerance=0.01, On=Toggle(True))  # -> I, V, O
pt_5 = Point(solver.V)
panel = Panel(solver.I)
panel_2 = Panel(solver.O)
data = Data(solver.O)
